# Grasshopper definition extractSensorIDLocations.ghx (Grasshopper 1.0.8)

# ----
# Extract Sensor Locations to a file.
# Right click and
# Sream Contents
query_model_objects = QueryModelObjects(Name="??", Locked=True, Hidden=True, AutoUpdateState=True)
model_object = ModelObject(Object=query_model_objects)  # -> Object, Geometry, Name, Layer, Visibility, Display, Drafting, Render
vector = Vector(query_model_objects)
concatenate = Concatenate(FragmentA=model_object.Name, FragmentB=vector, JoinSeparator=" ")
panel = Panel(concatenate)

python_3_script = Python3Script()  # -> out, a; unedited script template
