# Grasshopper definition slab_sensors_Vis.ghx (Grasshopper 1.0.8)

slicestartminute = Slider(0, range=0..60)
slicestartsecond = Slider(0, range=0..60)
slicestartyear = Slider(2026, range=2025..2030)
slicestartmonth = Slider(1, range=1..12)
slicestartday = Slider(3, range=1..31)
slicestarthour = Slider(7, range=0..24)

sliceseconds = Slider(0, range=0..60)
slicehours = Slider(0, range=0..24)
sliceminutes = Slider(12, range=0..60)
slicedays = Slider(0, range=0..24)

py3 = Python3Script(n=Slider(73, range=0..100))  # -> out, a; inputs n: Int32
# ---------- py3: Python ----------
"""Grasshopper Script"""
import System
import Rhino
import Grasshopper

import rhinoscriptsyntax as rs
global n

class MyComponent(Grasshopper.Kernel.GH_ScriptInstance):
    def RunScript(self, n: int):
        a = [3.1 for i in range(n)]
        print(len(a))
        
        return a

    # Solve overrides 
    def BeforeRunScript(self):
        pass

    def AfterRunScript(self):
        pass
# ---------- end py3 ----------
panel = Panel(py3.out)
panel_2 = Panel(py3.a)
path = FilePath("/Users/paul/SensorProject/Garage/SensorReadings_2026-01-19.db")
time_slice = Python3Script(
    dbName=path,
    sliceStartYear=slicestartyear,
    sliceStartMonth=slicestartmonth,
    sliceStartDay=slicestartday,
    sliceStartHour=slicestarthour,
    sliceStartMinute=slicestartminute,
    sliceStartSecond=slicestartsecond,
    sliceDays=slicedays,
    sliceHours=slicehours,
    sliceMinutes=sliceminutes,
    sliceSeconds=sliceseconds)  # -> out, IDtemperature, timeStamp, x, y, z, minTemp, maxTemp, temperature; inputs dbName: String, sliceStartYear: Int32, sliceStartMonth: Int32, sliceStartDay: Int32, sliceStartHour: Int32, sliceStartMinute: Int32, sliceStartSecond: Int32, sliceDays: Int32, sliceHours: Int32, sliceMinutes: Int32, sliceSeconds: Int32
# ---------- time_slice: Python ----------
# This is for a grasshopper script to read sensor data.
# See loadSensorReadingsSQLite  to load sensor readings to the db.
# See loadIDlocationsSQLite to load sensor locations to the db.

# Inputs:
#   dbName     eg 'SensorReadings.sqlite.db' selected with path browser
#   previously sliceStart   a string representing a datetime, eg '2025-08-03 18:18:30'
#      but does not work well with slider.
#   sliceStartYear   a number indicating start year   eg 2025
#   sliceStartMonth  a number indicating start month  eg 8
#   sliceStartDay    a number indicating start day    eg 3
#   sliceStartHour   a number indicating start hour   eg 18
#   sliceStartMinute a number indicating start minute (often 0)
#   sliceStartSecond a number indicating start second (normally 0)

#   sliceDays  an number indicating days for timedelta slice period (normally 0).
#   sliceHours an number indicating hours for timedelta slice period (often 0).
#   sliceMinutes an number indicating minutes for timedelta slice period.
#   sliceSeconds an number indicating seconds for timedelta slice period.

# Outputs:
# timeStamp, x,y,z, temperature, minTemp, maxTemp, IDtemperature

#  https://realpython.com/python-sql-libraries/
#  https://www.sqlitetutorial.net/sqlite-python/creating-tables
#  https://www.geeksforgeeks.org/python/python-convert-string-to-datetime-and-vice-versa/

#  This could all change if the db uses
#     detect_types=sqlite3.PARSE_DECLTYPES | sqlite3.PARSE_COLNAMES
#  which is possibly faster, but let's see.

# Slice is a short window used for a time period where most sensors will report.
# It might be 12 minutes if sensors report every 10 minutes.
# If there is more than one report for a sensor then the last one will get used.
# The term Window may get future use to indicate a longer period to scroll through.

import sqlite3
from datetime import datetime, timedelta # library and a module are both called datetime

fmt = '%Y-%m-%d %H:%M:%S'

# test values for grasshopper inputs
#dbName = "SensorReadings_2026-01-19.db"
#
# slice for first test data
# previously sliceStart ='2025-08-03 18:18:30'
#sliceStartYear  = 2025
#sliceStartMonth = 8
#sliceStartDay   = 3
#sliceStartHour   = 18
#sliceStartMinute = 18
#sliceStartSecond = 30
#
#sliceDays = 0
#sliceHours = 0
#sliceMinutes = 12
#sliceSeconds = 0
#
#
# previously sliceStart ='2026-01-03 00:12:00'
# previously SliceStart  = datetime.strptime(sliceStart, fmt)

#sliceStartYear  = 2026
#sliceStartMonth = 1
#sliceStartDay   = 3
#sliceStartHour   =  0
#sliceStartMinute = 12
#sliceStartSecond =  0
#
#sliceDays = 0
#sliceHours = 2
#sliceMinutes = 0
#sliceSeconds = 0

SliceStart  = datetime(year=sliceStartYear, month=sliceStartMonth, day=sliceStartDay,
                hour=sliceStartHour, minute=sliceStartMinute, second=sliceStartSecond )

SliceEnd = SliceStart + timedelta(days=sliceDays, 
                      hours=sliceHours, minutes=sliceMinutes, seconds=sliceSeconds)
#print(SliceEnd)


con = sqlite3.connect(dbName)
#con = sqlite3.connect(dbName, mode="ro")  #CHECK READ ONLY MODE
#con = sqlite3.connect(dbName + '?mode=ro', uri=True)  CHECK READ ONLY MODE this creates new db

st = "(timeStamp > '" +SliceStart.strftime(fmt) + "')"
en = "(timeStamp < '" +   SliceEnd.strftime(fmt) + "')"

q = "SELECT sensorData.id, timeStamp, temperature, x, y, z FROM sensorData INNER JOIN \
    sensorLocation ON sensorData.id = sensorLocation.id  WHERE " + st + " AND " +  en 
    
zz = con.execute(q).fetchall()
print("records returned ", len(zz))

timeStamp   = [ v[1]  for v in zz ]
temperature = [ v[2]  for v in zz ]
x = [ v[3]  for v in zz ]
y = [ v[4]  for v in zz ]
z = [ v[5]  for v in zz ]

IDtemperature = [ [v[0],v[2]]  for v in zz ]

minTemp = min(temperature)
maxTemp = max(temperature)

con.close()
# ---------- end time_slice ----------
panel_3 = Panel(time_slice.out)
highest_temperature = Slider(20.561, range=0..50)
lowest_temperature = Slider(9.902, range=-30..20)
vec = VectorXYZ(XComponent=time_slice.x, YComponent=time_slice.y, ZComponent=time_slice.z)  # -> Vector, Length
gradient = Gradient(
    LowerLimit=time_slice.minTemp,
    UpperLimit=highest_temperature,
    Parameter=time_slice.temperature,
    stops=[0: RGB(48, 18, 59), 0.0294: RGB(56, 40, 112), 0.0588: RGB(63, 62, 156), 0.0882: RGB(68, 82, 193), 0.118: RGB(70, 102, 221), 0.147: RGB(71, 122, 241)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])
panel_4 = Panel(time_slice.IDtemperature)
dot_size = Slider(2, range=0..7)
dots = DotDisplay(Point=vec.Vector, Colour=gradient, Size=dot_size)
colour_picker = ColourPicker(PickedColour=RGB(11, 3, 26))
text_tag = TextTag(Location=vec.Vector, Text=time_slice.temperature, Colour=colour_picker)
